# Grasshopper definition jie.gh (Grasshopper 1.0.7)

pu = CSharpScript()  # -> out, A, B
# ---------- pu: C# usings ----------
using System.IO;
using System.Linq;
using System.Data;
using System.Drawing;
using System.Reflection;
using System.Windows.Forms;
using System.Xml;
using System.Xml.Linq;
using System.Runtime.InteropServices;

using Rhino.DocObjects;
using Rhino.Collections;
using GH_IO;
using GH_IO.Serialization;
# ---------- pu: C# ----------
    List<string> F = new List<string>();

    A = false;

    string zhuo = System.Environment.GetFolderPath(System.Environment.SpecialFolder.Desktop);
    DirectoryInfo di = new DirectoryInfo(zhuo);
    foreach (FileInfo fi in di.GetFiles("*.gh"))
    {
      F.Add(Path.GetFileName(fi.Name));

    }

    B = F;



    foreach(string q in F)
    {


      bool d = true;
      GH_Document aa = Grasshopper.Instances.DocumentServer.AddDocument(zhuo + "\\" + q, false);


      foreach (GH_DocumentObject j in aa.ActiveObjects())
      {
        if (j.NickName == "pu" || j.NickName == "tian" || j.NickName == "tongqing" ||j.NickName == "tong"||j.NickName == "qing")
        {

          if (q != "jie.gh")
          {
            aa.Objects.Remove((IGH_DocumentObject) j);

          }

          d = false;
        }

      }

      int a = 0;

      //Grasshopper.Instances.ActiveCanvas.Document.AddObject(objects[i]);




      // var io = new GH_DocumentIO(aa);
      //io.Copy(GH_ClipboardType.System);
      // io.SaveAs();
      GH_Archive archive = new GH_Archive();
      archive.AppendObject(aa, "Definition");
      archive.WriteToFile(zhuo + "\\" + q, true, false);
      //File.WriteAllBytes(F1, archive.Serialize_Binary());

    }
# ---------- end pu ----------
tongqing = Panel(pu.B)
