# Grasshopper definition 暴力解密最终版.gh (Grasshopper 1.0.7)

button = Button()  # disabled

# ---- group: 点击按钮，这个电池别动
_233 = CSharpScript(解密=button)  # -> A; inputs 解密: Boolean
# ---------- _233: C# ----------
 


    GH_Document gH_Document = this.Component.OnPingDocument();
    List<IGH_ActiveObject> objList = gH_Document.ActiveObjects();


    Type type = typeof( Grasshopper.Kernel.Special.GH_Cluster);
    for(int i = 0;i < objList.Count;i++){

      if( objList[i].GetType() == type){
        ((Grasshopper.Kernel.Special.GH_Cluster) (objList[i])).ExplodeCluster();}}
    GH_Document.EnableSolutions = !GH_Document.EnableSolutions;
# ---------- end _233 ----------

# ----
python = GhPythonScript()  # -> Out, A; disabled
